# Grasshopper definition Ribbed_1.7_round_K20N6.gh (Grasshopper 1.0.7)
# plug-ins: Bifocals, Karamba3D, CEM_Build_Topology_2.0, CEM_Trail_2.0, CEM_Load_2.0, CEM_Deviation_2.0, CEM_Support_2.0, CEM_Extract_Topology_2.0, CEM_Constraint_Plane_2.0, CEM_Origin_Node_2.0, CEM_Material_Properties_2.0, CEM_Target_Node_2.0, CEM_Bound_Origin_Node_2.0, CEM_Bound_Trail_2.0, CEM_Bound_Deviation_2.0, CEM_Optimization_Setup_2.0, CEM_Calculate_Structure_2.0, CEM_Bound_Load_2.0, CEM_Min_Load_Path_2.0, CEM_Target_Vector_2.0, CEM_Extract_Structure_2.0

nb = Slider(1, range=0..10)
number_slider = Slider(14.1, range=-20000..1000)
panel = Panel("""26.2
23.0
19.2
14.7
9.7
4.2""")
panel_2 = Panel("""13
26
39
46
45
44""")
negative = Negative(Value=number_slider)
negative_2 = Negative(Value=panel)
negative_3 = Negative(Value=panel_2)

# ---- group: Ribbed_Modelling
span = Slider(1000, range=0..2000)
rise = Slider(333, range=0..500)
nf = Slider(20, range=1..30)
nz = Slider(6, range=0..15)
expression = Expression(l=span, h=rise, Expression="(4*h²+l²)/(8*h)")
construct_point = ConstructPoint(XCoordinate=expr("0.5*x", span), YCoordinate=0, ZCoordinate=0)
construct_point_2 = ConstructPoint(XCoordinate=Slider(65, range=0..200), YCoordinate=0, ZCoordinate=0)
sphere = Sphere(Base=PlaneXY(0, 0, 0), Radius=expression)
line = Line(StartPoint=construct_point_2, EndPoint=construct_point)
project = Project(Curve=line, Brep=sphere, Direction=Vector(0, 0, 1))
list_item = ListItem(List=project, Index=0, Wrap=True)  # -> Item1, Item
divide_curve = DivideCurve(Curve=list_item.Item1, Count=nz, Kinks=False)  # -> Points, Tangents, Parameters
deconstruct = Deconstruct(Point=divide_curve.Points)  # -> XComponent, YComponent, ZComponent
circle = Circle(Plane=PlaneXY(0, 0, 0), Radius=deconstruct.XComponent)
length = Length(Curve=circle)
unit_z = UnitZ(Factor=1)
polyline = PolyLine(Vertices=divide_curve.Points, Closed=False)
explode = Explode(Curve=polyline, Recursive=True)  # -> Segments, Vertices

# ----
multiplication = Multiplication(A=nf, B=nb)

# ---- group: Ribbed_Modelling (continued)
division = Division(A=length, B=multiplication)
construct_domain = ConstructDomain(DomainStart=0, DomainEnd=division)
sub_curve = SubCurve(BaseCurve=circle, Domain=construct_domain)
divide_curve_2 = DivideCurve(Curve=sub_curve, Count=1, Kinks=False)  # -> Points, Tangents, Parameters
project_point = ProjectPoint(Point=divide_curve_2.Points, Direction=unit_z, Geometry=sphere)  # -> simplify(Point), Index
polyline_2 = PolyLine(Vertices=project_point.Point, Closed=False)
polar_array = PolarArray(Geometry=polyline_2, Plane=PlaneXY(0, 0, 0), Count=multiplication, Angle=6.283185307)  # -> Geometry, Transform
polar_array_2 = PolarArray(Geometry=explode.Segments, Plane=PlaneXY(0, 0, 0), Count=multiplication, Angle=6.283185307)  # -> Geometry, Transform
explode_2 = Explode(Curve=polar_array.Geometry, Recursive=True)  # -> Segments, Vertices
explode_3 = Explode(Curve=polar_array_2.Geometry, Recursive=True)  # -> Segments, Vertices
point = Point(simplify(explode_3.Vertices))
point_2 = Point(simplify(explode_2.Vertices))
line_2 = Line(simplify(flatten(explode_3.Segments)))
trim_tree = TrimTree(Tree=simplify(explode_2.Segments), Depth=1)
create_set = CreateSet(List=flatten(point_2))  # -> Set, Map
list_item_2 = ListItem(List=point_2, Index=0, Wrap=True)
point_3 = Point(create_set.Set)
point_list = PointList(Points=point_3, Size=10)
reverse_list = ReverseList(List=point_3)
list_length = ListLength(List=flatten(point_3))
split_list = SplitList(List=point_3, Index=multiplication)  # -> ListA, ListB
list_length_2 = ListLength(List=flatten(split_list.ListB))
point_4 = Point(flatten(point_3))
curve = Curve(flatten(line_2))
point_5 = Point(flatten(split_list.ListA))
curve_2 = Curve(flatten(trim_tree))

# ----
curve_3 = Curve(flatten([curve, curve_2]))  # disabled
point_6 = Point(point_3)  # disabled

# ---- group: FEM / Support
point_7 = Point(point_6)  # disabled
deconstruct_2 = Deconstruct(Point=point_7)  # -> XComponent, YComponent, ZComponent; disabled
sort_list = SortList(Keys=deconstruct_2.ZComponent)  # -> Keys, ValuesValuesA; disabled
list_item_3 = ListItem(List=sort_list.Keys, Index=0, Wrap=True)  # disabled
subtraction = Subtraction(A=deconstruct_2.ZComponent, B=list_item_3)  # disabled
number_slider_2 = Slider(0.5, range=0..1)  # disabled
absolute = Absolute(Value=subtraction)  # disabled
smaller_than = SmallerThan(FirstNumber=absolute, SecondNumber=number_slider_2)  # -> SmallerThan, OrEqualTo; disabled
dispatch = Dispatch(List=point_7, DispatchPattern=smaller_than.SmallerThan)  # -> ListA, ListB; disabled
point_8 = Point(dispatch.ListA)  # disabled
support_karamba3d = SupportKaramba3D(PosInd=point_8, menu=[buttons(on, on, on, off, off, off)])  # disabled

# ---- group: FEM / Load 1
number_slider_3 = Slider(8.2, range=-20000..1000)  # disabled
panel_3 = Panel("""15.6
14.1
11.9
9.3
6.2
3.0""")  # disabled
number_slider_4 = Slider(0, range=-10..10)  # disabled
number_slider_5 = Slider(0, range=-10..10)  # disabled
negative_4 = Negative(Value=number_slider_3)  # disabled
negative_5 = Negative(Value=panel_3)  # disabled
duplicate_data = DuplicateData(Data=number_slider_4, Number=list_length, Order=True)  # disabled
duplicate_data_2 = DuplicateData(Data=number_slider_5, Number=list_length, Order=True)  # disabled
duplicate_data_3 = DuplicateData(Data=negative_4, Number=multiplication, Order=False)  # disabled
duplicate_data_4 = DuplicateData(Data=negative_5, Number=multiplication, Order=False)  # disabled
merge = Merge(Data1=duplicate_data_3, Data2=duplicate_data_4)  # disabled
vector_xyz = VectorXYZ(XComponent=flatten(duplicate_data), YComponent=flatten(duplicate_data_2), ZComponent=expr("X*1000", flatten(merge)))  # -> Vector, Length; disabled
loads_karamba3d = LoadsKaramba3D(ForceVector=vector_xyz.Vector, Local=False, PosInd=point_6, LCase="0", mode="Point")  # disabled

# ---- group: FEM / Element
line_3 = Line(curve_3)  # disabled
list_length_3 = ListLength(List=line_3)  # disabled
series = Series(Start=0, Step=1, Count=list_length_3)  # disabled
panel_4 = Panel("beam")  # disabled
material_selection_karamba3d = MaterialSelectionKaramba3D(menu=[dropdown(6), dropdown(43)])  # disabled
number_slider_6 = Slider(5, range=1..10)  # disabled
number_slider_7 = Slider(300, range=1..500)  # disabled
longest_list = LongestList(ListListA=panel_4, ListListB=series, PaddingMode=2)  # -> graft(ListListA), graft(ListListB); disabled
merge_2 = Merge(Data1=longest_list.ListListA, Data2=longest_list.ListListB)  # -> simplify(Result); disabled
cross_section_karamba3d = CrossSectionKaramba3D(
    FamilyNameOfCrossSection="DefaultCroSec",
    Material=material_selection_karamba3d,
    Diameter_cm=number_slider_7,
    WallThickness_cm=number_slider_6,
    mode="Circular Hollow")  # disabled
text_join = TextJoin(Text=merge_2)  # -> flatten(Result); disabled
line_to_beam_karamba3d = LineToBeamKaramba3D(
    Line=line_3,
    Identifier=text_join,
    CrossSection=cross_section_karamba3d,
    New=True,
    Remove=True,
    LimitDistance_m=0.005,
    Bending=True,
    SetBucklingLength=True,
    ToPolylineMaxAngle=0.03,
    ToPolylineTolerance=0.01,
    ToPolylineMaxEdgeLength=0.25)  # -> Element, Points, Info; disabled

# ---- group: FEM
assemble_model_karamba3d = AssembleModelKaramba3D(
    Elem=flatten(line_to_beam_karamba3d.Element),
    Support=flatten(support_karamba3d),
    Load=flatten(loads_karamba3d),
    LimitDistance_m=0.005)  # -> Model, Info, Mass_kg, CenterOfGravity, LoadCaseNames; disabled
analyze_nonlinear_wip_karamba3d = AnalyzeNonlinearWIPKaramba3D(
    Model=assemble_model_karamba3d.Model,
    NumberOfLoadSteps=1,
    NumberOfLoadIncrements=5,
    MaxNumberOfEquilibriumIterations=50,
    EquilibriumTolerance=1e-07,
    MaxNumberOfLimitLoadIterations=50,
    LimitLoadTolerance=0.01,
    mode="NewtonRaphson")  # -> CalculatedModel, MaximumDisplacement_cm, ElasticEnergy_kNm, Info, Lambdas; disabled
model_view_karamba3d = ModelViewKaramba3D(Model=analyze_nonlinear_wip_karamba3d.CalculatedModel, ResultFactors=1, ResultCase=-1)  # -> Model, DeformedMesh, DeformedAxes, DeformedModel; disabled
curve_4 = Curve(model_view_karamba3d.DeformedAxes)  # disabled
beam_view_karamba3d = BeamViewKaramba3D(Model=model_view_karamba3d.Model)  # -> Model, MeshesOfRenderedBeams, DeformedBeamAxes, LegendColors, LegendTags; disabled
legend = Legend(Colour=beam_view_karamba3d.LegendColors, Tags=beam_view_karamba3d.LegendTags, LegendType=101)  # disabled

# ----
duplicate_data_5 = DuplicateData(Data=negative, Number=multiplication, Order=False)
duplicate_data_6 = DuplicateData(Data=negative_2, Number=multiplication, Order=False)
duplicate_data_7 = DuplicateData(Data=Slider(-0.2, range=-20000..1000), Number=multiplication, Order=False)
merge_3 = Merge(Data1=duplicate_data_5, Data2=duplicate_data_6)

# ---- group: CEM / CEM_Build_Topology
support = Point(flatten(point_5))
# CEM - Release 2.00
# If you use the library of CEM in a project, please refer to the CEM GitHub repository:
# 
# @Misc{cem2021,
# author = {Ohlbrock, Patrick Ole and D'Acunto, Pierluigi},
# title = {{CEM: Combinatorial Equilibrium Modeling}},
# year = {2021},
# note = {Release 2.00},
# url = { http://github.com/OleOhlbrock/CEM },
# }
trailedge = Curve(flatten(curve))
pointload = Point(flatten(point_4))
deviationedge = Curve(flatten(curve_2))
duplicate_data_8 = DuplicateData(Data=Slider(0, range=-10..10), Number=list_length, Order=True)
duplicate_data_9 = DuplicateData(Data=Slider(0, range=-10..10), Number=list_length, Order=True)
duplicate_data_10 = DuplicateData(Data=negative_3, Number=multiplication, Order=False)
cem_load_2_0 = CEM_Load_20(
    PointLoad=flatten(pointload),
    LoadMagnX=flatten(duplicate_data_8),
    LoadMagnY=flatten(duplicate_data_9),
    LoadMagnZ=flatten(merge_3))
cem_trail_2_0 = CEM_Trail_20(TrailEdge=flatten(trailedge), TrailLen=flatten(Slider(-93.2, range=-150..20)))
cem_support_2_0 = CEM_Support_20(Support=flatten(support))

# ----
merge_4 = Merge(Data1=duplicate_data_7, Data2=duplicate_data_10)

# ---- group: CEM / CEM_Build_Topology (continued)
cem_deviation_2_0 = CEM_Deviation_20(DeviationEdge=flatten(deviationedge), DeviationMagn=flatten(merge_4))
cem_build_topology_2_0 = CEM_Build_Topology_20(T=cem_trail_2_0, L=cem_load_2_0, D=cem_deviation_2_0, S=cem_support_2_0)

# ---- group: CEM
cem_extract_topology_2_0 = CEM_Extract_Topology_20(TP=cem_build_topology_2_0)  # -> Nodes, NodesID, Trails, TrailsID, Deviations, DeviationsID, AuxTrails, AuxTrailsID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
text_tag_3d = TextTag3D(
    Location=cem_extract_topology_2_0.Nodes,
    Text=cem_extract_topology_2_0.NodesID,
    Size=10,
    Colour=RGB(51, 51, 23),
    Justification=7)
text_tag_3d_2 = TextTag3D(
    Location=[cem_extract_topology_2_0.Trails, cem_extract_topology_2_0.Deviations],
    Text=[cem_extract_topology_2_0.TrailsID, cem_extract_topology_2_0.DeviationsID],
    Size=7,
    Colour=RGB(0, 108, 148),
    Justification=7)
plane = Plane(cem_extract_topology_2_0.ConstraintPlane)
point_9 = Point(cem_extract_topology_2_0.OriginNode)

# ----
list_item_4 = ListItem(List=cem_extract_topology_2_0.Nodes, Index=Slider(30, range=0..30), Wrap=True)

# ---- group: CEM / CEM_Calculate_Structure
series_2 = Series(Start=0, Step=2, Count=multiplication)
concatenate = Concatenate(FragmentA="V", FragmentB=series_2)
specific_weight_kn_m3 = Slider(123.06, range=5..500)
boundscoefficientoriginnode = Slider(0, range=0..1000)
yieldstress_kn_m2 = Slider(260000, range=50..1000000)
number_slider_8 = Slider(100, range=0..5000)
number_slider_9 = Slider(50, range=0..5000)
targetvectorcoeffmag = Slider(0, range=0..10000)
targetvectorcoeffdir = Slider(0, range=0..10000)
minloadpathcoeff = Slider(0, range=0..1000)
number_slider_10 = Slider(0, range=0..5000)
number_slider_11 = Slider(0, range=0..5000)
value_list = ValueList({"LD_AUGLAG", "LD_LBFGS", "LD_SLSQP", "LD_TNEWTON", "LN_BOBYQA", "LN_COBYLA", "LN_SBPLX", "GD_MLSL", "GN_MLSL", "GN_ISRES"}, selected="LD_LBFGS")
self_weight = BooleanToggle(False)
targetnodes = Point(support)
cem_bound_origin_node_2_0 = CEM_Bound_Origin_Node_20(
    BoundOriginNodeID=flatten(cem_extract_topology_2_0.OriginNodeID),
    BoundUpOriginNodeZ=flatten(boundscoefficientoriginnode),
    BoundLowOriginNodeZ=flatten(boundscoefficientoriginnode))
cem_target_vector_2_0 = CEM_Target_Vector_20(TargetVectorCoeffMag=targetvectorcoeffmag, TargetVectorCoeffDir=targetvectorcoeffdir)
cem_constraint_plane_2_0 = CEM_Constraint_Plane_20(
    ConstraintPlane=flatten(cem_extract_topology_2_0.ConstraintPlane),
    ConstraintPlaneID=flatten(cem_extract_topology_2_0.ConstraintPlaneID))
cem_target_node_2_0 = CEM_Target_Node_20(TargetNode=flatten(targetnodes), TargetNodeID=flatten(concatenate), TargetNodeCoeff=flatten(Slider(0.01, range=0..100)))
cem_bound_load_2_0 = CEM_Bound_Load_20(
    BoundLoadID=flatten(cem_extract_topology_2_0.LoadsID),
    BoundUpLoadX=flatten(number_slider_10),
    BoundLowLoadX=flatten(number_slider_10),
    BoundUpLoadY=flatten(number_slider_10),
    BoundLowLoadY=flatten(number_slider_10),
    BoundUpLoadZ=flatten(number_slider_11),
    BoundLowLoadZ=flatten(number_slider_11))
cem_min_load_path_2_0 = CEM_Min_Load_Path_20(MinLoadPath=Toggle(False), MinLoadPathCoeff=minloadpathcoeff)
cem_bound_trail_2_0 = CEM_Bound_Trail_20(
    BoundTrailID=flatten(cem_extract_topology_2_0.TrailsID),
    BoundUpTrail=flatten(number_slider_8),
    BoundLowTrail=flatten(number_slider_8))
cem_bound_deviation_2_0 = CEM_Bound_Deviation_20(
    BoundDevID=flatten(cem_extract_topology_2_0.DeviationsID),
    BoundUpDev=flatten(number_slider_9),
    BoundLowDev=flatten(number_slider_9))
cem_material_properties_2_0 = CEM_Material_Properties_20(SelfWeight=flatten(self_weight), YieldStress=flatten(yieldstress_kn_m2), SpecWeight=flatten(specific_weight_kn_m3))
cem_origin_node_2_0 = CEM_Origin_Node_20(OriginNode=flatten(cem_extract_topology_2_0.OriginNode), OriginNodeID=flatten(cem_extract_topology_2_0.OriginNodeID))
cem_optimization_setup_2_0 = CEM_Optimization_Setup_20(
    TN=cem_target_node_2_0,
    TV=cem_target_vector_2_0,
    LP=cem_min_load_path_2_0,
    BO=cem_bound_origin_node_2_0,
    BT=cem_bound_trail_2_0,
    BD=cem_bound_deviation_2_0,
    GradientDelta=Slider(0.0001, range=0.0001..1),
    RelativeTolerance=Slider(1e-06, range=1e-06..1),
    MaxIterations=Slider(10, range=1..100),
    OptimAlgorithm=value_list)
cem_calculate_structure_2_0 = CEM_Calculate_Structure_20(MarshallingSignalParameter=cem_build_topology_2_0, N=cem_origin_node_2_0, SW=cem_material_properties_2_0)

# ---- group: CEM (continued)
cem_extract_structure_2_0 = CEM_Extract_Structure_20(M=cem_calculate_structure_2_0)  # -> reverse(Nodes), reverse(NodesID), reverse(Trails), reverse(TrailsID), reverse(TrailsCol), reverse(TrailsMag), Deviations, DeviationsID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
panel_5 = Panel(cem_calculate_structure_2_0)
text_tag_3d_3 = TextTag3D(
    Location=cem_extract_structure_2_0.Nodes,
    Text=cem_extract_structure_2_0.NodesID,
    Size=10,
    Colour=RGB(230, 21, 160),
    Justification=7)
custom_preview = CustomPreview(
    Geometry=[cem_extract_structure_2_0.Trails, cem_extract_structure_2_0.Deviations],
    Material=[cem_extract_structure_2_0.TrailsCol, cem_extract_structure_2_0.DeviationsCol])
line_4 = Line([cem_extract_structure_2_0.Trails, cem_extract_structure_2_0.Deviations])
point_10 = Point(cem_extract_structure_2_0.Nodes)

# ----
panel_6 = Panel(cem_extract_structure_2_0.TrailsMag)
list_item_5 = ListItem(List=cem_extract_structure_2_0.Trails, Index=Slider(26, range=0..30), Wrap=True)

# ---- group: Output
text_split = TextSplit(Text=cem_extract_structure_2_0.NodesID, Separators="V")  # -> flatten(Result)
cull_pattern = CullPattern(List=text_split, CullPattern=[False, True])
sort_list_2 = SortList(Keys=cull_pattern, ValuesValuesA=cem_extract_structure_2_0.Nodes)  # -> Keys, ValuesValuesA
split_list_2 = SplitList(List=sort_list_2.ValuesValuesA, Index=expr("x*2", multiplication))  # -> ListA, ListB
dispatch_2 = Dispatch(List=split_list_2.ListA, DispatchPattern=[True, False])  # -> ListA, ListB
merge_5 = Merge(Data1=dispatch_2.ListA, Data2=dispatch_2.ListB, Data3=split_list_2.ListB)  # -> reverse(Result)
list_item_6 = ListItem(List=merge_5, Index=Slider(30, range=0..30), Wrap=True)
panel_7 = Panel(merge_5)
deconstruct_3 = Deconstruct(Point=merge_5)  # -> expr("x*1000", XComponent), expr("x*1000", YComponent), expr("x*1000", ZComponent)
panel_8 = Panel(deconstruct_3.YComponent)
panel_9 = Panel(deconstruct_3.ZComponent)
panel_10 = Panel(deconstruct_3.XComponent)

# ---- group: FEM / Support
point_11 = Point(point_10)
deconstruct_4 = Deconstruct(Point=point_11)  # -> XComponent, YComponent, ZComponent
sort_list_3 = SortList(Keys=deconstruct_4.ZComponent)  # -> Keys, ValuesValuesA
list_item_7 = ListItem(List=sort_list_3.Keys, Index=0, Wrap=True)
subtraction_2 = Subtraction(A=deconstruct_4.ZComponent, B=list_item_7)
absolute_2 = Absolute(Value=subtraction_2)
smaller_than_2 = SmallerThan(FirstNumber=absolute_2, SecondNumber=Slider(0.5, range=0..1))  # -> SmallerThan, OrEqualTo
dispatch_3 = Dispatch(List=point_11, DispatchPattern=smaller_than_2.SmallerThan)  # -> ListA, ListB
point_12 = Point(dispatch_3.ListA)
support_karamba3d_2 = SupportKaramba3D(PosInd=point_12, menu=[buttons(on, on, on, off, off, off)])

# ---- group: FEM / Element
line_5 = Line(line_4)
list_length_4 = ListLength(List=line_5)
series_3 = Series(Start=0, Step=1, Count=list_length_4)
material_selection_karamba3d_2 = MaterialSelectionKaramba3D(menu=[dropdown(6), dropdown(43)])
longest_list_2 = LongestList(ListListA="beam", ListListB=series_3, PaddingMode=2)  # -> graft(ListListA), graft(ListListB)
merge_6 = Merge(Data1=longest_list_2.ListListA, Data2=longest_list_2.ListListB)  # -> simplify(Result)
cross_section_karamba3d_2 = CrossSectionKaramba3D(
    FamilyNameOfCrossSection="DefaultCroSec",
    Material=material_selection_karamba3d_2,
    Diameter_cm=Slider(300, range=1..500),
    WallThickness_cm=Slider(5, range=1..10),
    mode="Circular Hollow")
text_join_2 = TextJoin(Text=merge_6)  # -> flatten(Result)
line_to_beam_karamba3d_2 = LineToBeamKaramba3D(
    Line=line_5,
    Identifier=text_join_2,
    CrossSection=cross_section_karamba3d_2,
    New=True,
    Remove=True,
    LimitDistance_m=0.005,
    Bending=True,
    SetBucklingLength=True,
    ToPolylineMaxAngle=0.03,
    ToPolylineTolerance=0.01,
    ToPolylineMaxEdgeLength=0.25)  # -> Element, Points, Info

# ---- group: FEM / Load 1
negative_6 = Negative(Value=number_slider)
negative_7 = Negative(Value=panel)
duplicate_data_11 = DuplicateData(Data=Slider(0, range=-10..10), Number=list_length, Order=True)
duplicate_data_12 = DuplicateData(Data=Slider(0, range=-10..10), Number=list_length, Order=True)
duplicate_data_13 = DuplicateData(Data=negative_6, Number=multiplication, Order=False)
duplicate_data_14 = DuplicateData(Data=negative_7, Number=multiplication, Order=False)
merge_7 = Merge(Data1=duplicate_data_13, Data2=duplicate_data_14)
vector_xyz_2 = VectorXYZ(
    XComponent=flatten(duplicate_data_11),
    YComponent=flatten(duplicate_data_12),
    ZComponent=expr("X*1000", flatten(merge_7)))  # -> Vector, Length
loads_karamba3d_2 = LoadsKaramba3D(ForceVector=vector_xyz_2.Vector, Local=False, PosInd=point_10, LCase="0", mode="Point")

# ---- group: FEM
assemble_model_karamba3d_2 = AssembleModelKaramba3D(
    Elem=flatten(line_to_beam_karamba3d_2.Element),
    Support=flatten(support_karamba3d_2),
    Load=flatten(loads_karamba3d_2),
    LimitDistance_m=0.005)  # -> Model, Info, Mass_kg, CenterOfGravity, LoadCaseNames
analyze_nonlinear_wip_karamba3d_2 = AnalyzeNonlinearWIPKaramba3D(
    Model=assemble_model_karamba3d_2.Model,
    NumberOfLoadSteps=1,
    NumberOfLoadIncrements=5,
    MaxNumberOfEquilibriumIterations=50,
    EquilibriumTolerance=1e-07,
    MaxNumberOfLimitLoadIterations=50,
    LimitLoadTolerance=0.01,
    mode="NewtonRaphson")  # -> CalculatedModel, MaximumDisplacement_cm, ElasticEnergy_kNm, Info, Lambdas
model_view_karamba3d_2 = ModelViewKaramba3D(Model=analyze_nonlinear_wip_karamba3d_2.CalculatedModel, ResultFactors=1, ResultCase=-1)  # -> Model, DeformedMesh, DeformedAxes, DeformedModel
curve_5 = Curve(model_view_karamba3d_2.DeformedAxes)
beam_view_karamba3d_2 = BeamViewKaramba3D(Model=model_view_karamba3d_2.Model)  # -> Model, MeshesOfRenderedBeams, DeformedBeamAxes, LegendColors, LegendTags
legend_2 = Legend(Colour=beam_view_karamba3d_2.LegendColors, Tags=beam_view_karamba3d_2.LegendTags, LegendType=101)
